# Grasshopper definition Kinect-ICP_V0.1.gh (Grasshopper 1.0.7)
# plug-ins: MetaHopper, EleFront, AzureKinect, Volvox, Heteroptera, Hops

bool_userchoice = BooleanToggle(False)
# Given a version number MAJOR.MINOR.PATCH, increment the:
# 
# MAJOR version when you make incompatible API changes,
# MINOR version when you add functionality in a backwards-compatible manner, and
# PATCH version when you make backwards-compatible bug fixes.
# Created by: Nathan Barnes
# Date:
# Project:
# Contact Info: nbarnes@azahner.com
# Contributors:
# Comments:
_001_description = Slider(63, range=0..100)

# ---- group: _in
# info: Blue indicates Variables and Input Geo that should not be changed
text_variablename = Panel("Hard Coded Variable")

# ----
# info: Options are User-Driven variables
# info: Key - Explains color and formatting
# conventions in the document
type_referencedgeometry = Curve()
text_variablename_2 = Data(text_variablename)

panel = Panel("""[
 
]""")

# ----
# Color Key
# goal: development goal or question needing checking
# info: Cyan: Script Output for visual check
# info: Title Text Lower Left -
# Subtext for explaining group functionality
# (short description of what this block does)
text_variablename_3 = Data(text_variablename_2)
text_variablename_4 = Panel(text_variablename_3)

# ---- group: _out
type_referencedgeometry_2 = EFDataDescription(type_referencedgeometry)

# ----
xy = XYPlane(Origin=Point(0, 0, 0))

# ----
# RHINO FILE:
toggle = GroupToggle(ToggleActive=True, ToggleVisible=False)  # disabled
# Changelog: 1. Change your personal details in the Title Block
# 
# 2. Save your own version locally
# 
# 3. Set up GH to load this template when starting new files:
# - File>Preferences>Files>Template File
scribbles = GetScribbles()  # -> Scribbles, ScribbleText, ScribblePlane, ScribbleSize; disabled
panel_2 = Panel("RHINO FILE:")  # disabled
tmatch = MatchText(Text=scribbles.ScribbleText, Pattern="RHINO FILE:*", Case=True)  # disabled
c_script = CSharpScript()  # -> out, A; disabled
# ---------- c_script: C# ----------
A = RhinoDocument.Path;
# ---------- end c_script ----------
cull = CullPattern(List=scribbles.Scribbles, CullPattern=tmatch)  # disabled
concat = Concatenate(FragmentA=panel_2, FragmentB=c_script.A)  # disabled
setscribble = SetScribbleProperties(Scribble=cull, ScribbleText=concat)  # disabled

chairmesh2 = Mesh(<mesh referenced from the Rhino model>)
chairmesh = Mesh(<mesh referenced from the Rhino model>)
xy_2 = XYPlane(Origin=Point(0, 0, 0))
bbox = BoundingBox(Content=chairmesh2, Plane=PlaneXY(0, 0, 0), UnionBox=True)  # -> Box, Box_2
start = Data({Plane=PlaneXY(0, 0, 0), X=Domain(-18.26573347, 0.857033525), Y=Domain(-44.18756649, -22.70374949), Z=Domain(-71.88240766, -40.18309855)})
start2 = Data({Plane=PlaneXY(0, 0, 0), X=Domain(-57.59223324, -33.23007025), Y=Domain(-73.85098725, -48.73141882), Z=Domain(-69.01822074, -36.99538266)})
# Wide mode if target is close to the camera, Narrow mode if target is further.
capture_frame_rate = ValueList({"Wide 1024px": 0, "Wide 512px": 1, "Narrow 640px": 2, "Narrow 320px": 3}, selected="Narrow 320px")
capture_frame_rate_2 = ValueList({"5 fps": 0, "15 fps": 1, "30 fps": 2}, selected="30 fps")

toggle_2 = GroupToggle(ToggleActive=True, ToggleVisible=False)  # disabled
panel_3 = Panel("RHINO FILE:*")  # disabled
open_rhino = BooleanToggle(False)  # disabled
scribbles_2 = GetScribbles()  # -> Scribbles, ScribbleText, ScribblePlane, ScribbleSize; disabled
tmatch_2 = MatchText(Text=scribbles_2.ScribbleText, Pattern=panel_3, Case=True)  # disabled
panel_4 = Panel(":")  # disabled
cull_2 = CullPattern(List=scribbles_2.ScribbleText, CullPattern=tmatch_2)  # disabled
split = TextSplit(Text=cull_2, Separators=panel_4)  # disabled
split_2 = SplitList(List=split, Index=1)  # -> ListA, ListB; disabled
join = TextJoin(Text=split_2.ListB, Join=panel_4)  # disabled
python = GhPythonScript(FilePath=join, Bool=open_rhino)  # inputs Bool: Boolean; disabled
# ---------- python: Python ----------
"""Script to open rhino file
    added space exception
    """

__author__ = "nbarnes"
__version__ = "2019.05.01"

import rhinoscriptsyntax as rs
import Rhino as r


def addDocEvent(sender,e):
    # Update this GH component 
    #ghenv.Component.ExpireSolution(False)
    ghenv.Component.ExpireSolution(True)
    



#r.RhinoApp.Initialized += addDocEvent
#r.RhinoDoc.IsInitializing += addDocEvent

#ghenv.Component.ExpireSolution(True)

#print "Open {0}".format(FilePath)
if Bool:
    
    #r.RhinoDoc.Open(FilePath)
    print FilePath
    rs.Command("!_-Open No " + '"' + "{0}".format(FilePath) + '"')
    #r.RhinoDoc.OpenFile(FilePath)
    ##ghenv.Component.ExpireSolution(True)
# ---------- end python ----------

# ----
# Source:
#  -https://andrewjinho.com/author/andrewjinho/
# 
# -https://www.food4rhino.com/en/app/azure-kinect-gh
trigger = Trigger(Interval=15000, TimerInterval=15000, Target=azurekinect)
ptcloud = BooleanToggle(True)
start_2 = BooleanToggle(True)
toggle_3 = BooleanToggle(True)  # disabled
# Point cloud reconstruction
clo = Cloud(<cloud referenced from the Rhino model>)  # disabled
geo = Geometry([<brep referenced from the Rhino model> x3])  # disabled
panel_5 = Panel(".25")  # disabled
azurekinect = AzureKinect(Active=start_2, PointCloud=ptcloud, BodyTracker=False, FrameRate=capture_frame_rate_2, DepthMode=capture_frame_rate)  # -> Message, PointCloud, SkeletonPoints, SkeletonConnections
bbox_2 = BoundingBox(Content=geo, Plane=PlaneXY(0, 0, 0), UnionBox=True)  # -> Box, Box_2; disabled
sec = CloudPlane(Cloud=clo, Plane=geo, Tolerance=panel_5, Project=toggle_3)  # disabled
panel_6 = Panel("""0
1""")  # disabled
box = Geometry(<brep referenced from the Rhino model>)
regtrsh = Geometry(<brep referenced from the Rhino model>)
registration = Geometry([<brep referenced from the Rhino model> x6])
wall = Geometry([<brep referenced from the Rhino model> x4])
item = ListItem(List=sec, Index=panel_6, Wrap=True)  # disabled
mm = Panel("0.0393701")
boxprop = BoxProperties(Box=bbox_2.Box)  # -> Center, Diagonal, Area, Volume, Degeneracy; disabled
sph = Sphere(Base=PlaneXY(0, 0, 0), Radius=expr("x/2", "2.25"))
sph_2 = Sphere(Base=PlaneXY(0, 0, 0), Radius=expr("x/2", "2.574803"))
merge = Merge(Data1=registration, Data2=wall)
panel_7 = Panel("25")  # disabled
decloud = DeconstructCloud(Cloud=item)  # -> Points, Normals, Colors; disabled
scale = Scale(Geometry=azurekinect.PointCloud, Center=Point(0, 0, 0), Factor=mm)  # -> Geometry, Transform
X = UnitX(Factor=1)
box_2 = BooleanToggle(True)
cir = Circle(Plane=boxprop.Center, Radius=panel_7)  # disabled
panel_8 = Panel("250")
panel_9 = Panel("55")
line = LineSDL(Start="0,0,0", Direction=X, Length=1)
alongcrv = SortAlongCurve(Points=decloud.Points, Curve=cir)  # -> Points, Indices; disabled

pt = Point(azurekinect.PointCloud)  # disabled
pdecon = Deconstruct(Point=pt)  # -> XComponent, YComponent, ZComponent; disabled
extremums = MinMax(Number=pdecon.YComponent)  # -> Minimum, Maximum; disabled
gradient = Gradient(
    LowerLimit=0,
    UpperLimit=extremums.Maximum,
    Parameter=pdecon.YComponent,
    stops=[0: RGB(237, 24, 0), 0.25: RGB(255, 144, 68), 0.5: RGB(253, 201, 45), 0.75: RGB(108, 250, 170), 1: RGB(65, 177, 244)])  # disabled
preview = CustomPreview(Geometry=pt, Material=gradient)  # disabled

rotax = RotateAxis(Geometry=scale.Geometry, Angle="7*pi/6", Axis=line)  # -> Geometry, Transform
nurbs = NurbsCurve(Vertices=alongcrv.Points, Degree=3, Periodic=False)  # -> Curve, Length, Domain; disabled
geo_2 = Geometry(<brep referenced from the Rhino model>)
group_names_to_ignore = Panel("_ignore")

# ---- group: Canvas Settings / _in
change_background_color = Button()
update_wires_and_groups = Button()

# ----
item_2 = ListItem(List=flatten(nurbs.Curve), Index=0, Wrap=True)  # -> Item, Item1; disabled

# ----
# Do not copy/modify/remove this
# component without setting enable to false first!
out_outputs = ColourSwatch(SwatchColor=RGBA(255, 144, 54, 150))
g_general = ColourSwatch(SwatchColor=RGBA(217, 217, 217, 150))
i_inputs = ColourSwatch(SwatchColor=RGBA(54, 255, 57, 150))
wires_and_groups = CSharpScript(Colors=[i_inputs, out_outputs, g_general], Enable=Toggle(False), debug=Toggle(False))  # -> out; inputs Colors: list of Color, Enable: Boolean, debug: Boolean
# ---------- wires_and_groups: C# usings ----------
using System.Linq;
using System.Text;
# ---------- wires_and_groups: C# ----------
    msg.Clear();
    _debug = debug; //Set to true to have all events printed in rhino log

    if (Enable)
    {
      SetupDict(); // Create a dictionary of the input swatches
      SetEventHandlers(); // This would do the job.
    }
    else
    {
      RemoveEventHandlers();
    }

    Print(msg.ToString());


    // Component setup
    Component.Description = "Set up event handlers to color groups based on prefixes such as 'in_' and 'out_'.\n"
      + "Please insert only swatcheds directly into the Colors input\n"
      + "MIT License. Copyright Mathias Sønderskov Schaltz 2022";
    Component.Params.Input[0].Description = "Please insert only swatcheds directly into the Colors input.\nRemember to rename them";
    Component.Params.Input[1].Description = "Toggle to run...";
    Component.Params.Input[2].Description = "Set debug to true to get all the events printed in the rhino log";
# ---------- wires_and_groups: C# additional code ----------
  Dictionary<string, System.Drawing.Color> colorDict = new Dictionary<string, System.Drawing.Color>();
  StringBuilder msg = new StringBuilder();
  bool _debug = false;


  public void SetupDict()
  {
    colorDict.Clear();
    // Get all inputs to "Colors"
    IList<IGH_Param> colorSources = this.Component.Params.Input[0].Sources;
    if (colorSources.Count == 0)
    {
      throw new Exception("You forgot to setup the colors. Please input swatch components and rename them");
    }
    foreach(IGH_Param source in colorSources)
    {
      //if (source.Type.ToString() == "Grasshopper.Kernel.Types.GH_Colour")
      if (source is Grasshopper.Kernel.Special.GH_ColourSwatch)
      {
        string nickName = source.NickName.Split('_')[0].Trim() + '_';
        if(!colorDict.ContainsKey(nickName))
        {
          Grasshopper.Kernel.Special.GH_ColourSwatch swatch = (Grasshopper.Kernel.Special.GH_ColourSwatch) source;
          colorDict.Add(nickName, swatch.SwatchColour);
        }
        else
        {
          throw new Exception("Multiple swatches using the same name detected. Please rename");
        }
      }
      else
      {
        throw new Exception("Whacko! Why did you input a non-swatch into the Colors? " + source.Type.ToString());
      }

    }

    msg.AppendFormat("Set up the dictionaries with {0} colors\n", colorDict.Count);
    foreach(var pairs in colorDict)
    {
      msg.AppendFormat("{0} -> {1}\n", ("\"" + pairs.Key + "\"").PadRight(5 + colorDict.Keys.Select(k => k.Length).Max()), pairs.Value);
    }
  }

  public void SetEventHandlers()
  {

    // Always remove events first to avoid duplicates
    GrasshopperDocument.ObjectsAdded -= OnObjectsAdded;
    GrasshopperDocument.ObjectsDeleted -= OnObjectsRemoved;
    GrasshopperDocument.ObjectsDeleted -= DeleteThisComponent;

    // Attach events
    GrasshopperDocument.ObjectsAdded += OnObjectsAdded;
    GrasshopperDocument.ObjectsDeleted += OnObjectsRemoved;
    GrasshopperDocument.ObjectsDeleted += DeleteThisComponent;


    foreach(Grasshopper.Kernel.Special.GH_Group grp in GrasshopperDocument.Objects.OfType<Grasshopper.Kernel.Special.GH_Group>())
    {
      grp.ObjectChanged -= ColorGroup;
      grp.ObjectChanged += ColorGroup;

      ColorGroup(grp, null); // Make sure to run it once
    }
    msg.AppendFormat("Added the eventhandlers on {0} existing groups and on future created groups", GrasshopperDocument.Objects.OfType<Grasshopper.Kernel.Special.GH_Group>().Count());
  }

  public void OnObjectsAdded(object sender, GH_DocObjectEventArgs e)
  {
    bool any = false;
    foreach (Grasshopper.Kernel.Special.GH_Group grp in e.Objects.OfType<Grasshopper.Kernel.Special.GH_Group>())
    {
      grp.ObjectChanged -= ColorGroup;
      grp.ObjectChanged += ColorGroup;
      any = true;
    }

    DebugWrite(any ? "Group Objects Added: Attaching Events to ObjectChanged" : "Objects Added - but no groups");
  }

  //Same but reversed
  public void OnObjectsRemoved(object sender, GH_DocObjectEventArgs e)
  {
    bool any = false;
    foreach (Grasshopper.Kernel.Special.GH_Group grp in e.Objects.OfType<Grasshopper.Kernel.Special.GH_Group>())
    {
      grp.ObjectChanged -= ColorGroup;
      any = true;
    }

    DebugWrite(any ? "Group Objects Removed, removing event" : "Objects Removed - although not a group");

  }



  public void RemoveEventHandlers()
  {
    GrasshopperDocument.ObjectsAdded -= OnObjectsAdded;
    GrasshopperDocument.ObjectsDeleted -= OnObjectsRemoved;


    foreach(Grasshopper.Kernel.Special.GH_Group grp in GrasshopperDocument.Objects.OfType<Grasshopper.Kernel.Special.GH_Group>())
    {
      grp.ObjectChanged -= ColorGroup;

    }
    msg.AppendFormat("Removed event handlers on document and on {0} groups\n", GrasshopperDocument.Objects.OfType<Grasshopper.Kernel.Special.GH_Group>().Count());

  }

  public void ColorGroup(object sender, EventArgs e)
  {

    Grasshopper.Kernel.Special.GH_Group grp = sender as Grasshopper.Kernel.Special.GH_Group;
    if (grp == null) return; //not type GH_Group
    //if (!grp.NickName.EndsWith("_")) return;


    string prefix = grp.NickName.Split('_')[0].Trim() + '_';

    string prefixes = String.Join(", ", colorDict.Keys.Select(k => "\"" + k + "\""));


    if (colorDict.ContainsKey(prefix))
    {
      if (grp.NickName.EndsWith("_"))
        grp.Colour = colorDict[prefix];
      grp.NickName = grp.NickName.Replace(prefix, "");

      DebugWrite("Colored " + grp.NickName);

    }
    else
    {
      //DebugWrite("Group changed but not relevant: prefix " + prefix + " is not among " + prefixes);
    }

  }
  public void DebugWrite(string msg)
  {
    if (_debug)
    {
      Rhino.RhinoApp.WriteLine(msg);
    }
  }

  public void DeleteThisComponent(object sender, GH_DocObjectEventArgs e)
  {

    if (e.Objects.OfType<Grasshopper.Kernel.GH_Component>().Where(o => o.NickName == this.Component.NickName).Any())
    {
      DebugWrite("Removed template component. Removing all the eventhandlers");
      RemoveEventHandlers();
    }


  }
# ---------- end wires_and_groups ----------
panel_10 = Panel(wires_and_groups)

bcrop = BoxCrop(Box=geo_2)
cloud = ConstructCloud(Points=rotax.Geometry)
lng = ListLength(List=cloud)
rec = DataRecorder(lng, DataLimit=-10, RecordData=True)
ma = MassAddition(Input=rec)  # -> Result, PartialResults
mod = Modulus(A=ma.Result, B="2")
python_2 = GhPythonScript(update=mod)  # -> out, TransformBox, count; inputs update: Boolean
# ---------- python_2: Python ----------
__author__ = "nbarnes"
__version__ = "2022.11.05"

import scriptcontext as rs

print("starting")


if (update == True or update == False):
    
    try:
        print ("start",  rs.sticky["transformCount"], rs.sticky["".format(rs.sticky["transformCount"])])
        
        TransformBox =   rs.sticky["".format(rs.sticky["transformCount"])]
        
        count = rs.sticky["transformCount"]
    #    print("dictionary", rs.sticky["transformCount"])
        
        
    except:
        rs.sticky["transformCount"] = 0
        print("added dictionary")
# ---------- end python_2 ----------
# ICP Transform
rep = ReplaceText(Text=python_2.TransformBox, Find=",", RecursiveReplace=False)
split_3 = TextSplit(Text=rep, Separators=panel)  # -> flatten(Result)
len = TextLength(Text=split_3)
smaller = SmallerThan(FirstNumber=len, SecondNumber=1)  # -> SmallerThan, OrEqualTo
cull_3 = CullPattern(List=split_3, CullPattern=invert(smaller.SmallerThan))
num = Number(cull_3)
smaller_2 = SmallerThan(FirstNumber=python_2.count, SecondNumber=4)  # -> SmallerThan, OrEqualTo
panel_11 = Panel(python_2.out)
matrix = ConstructMatrix(Rows="4", Columns="4", Values=num)
transform = Transform(Geometry=xy, Transform=matrix)
null = NullItem(Item=num)  # -> NullFlags, InvalidFlags, Description
panel_12 = Panel(mod)
filter = StreamFilter(Gate=smaller_2.OrEqualTo, Stream0=bbox.Box, Stream1=start2)
filter_2 = StreamFilter(Gate=smaller_2.OrEqualTo, Stream0=transform, Stream1=xy_2)
orient = Orient(Geometry=chairmesh2, Source=filter_2, Target=PlaneXY(0, 0, 0))  # -> Geometry, Transform
orient_2 = Orient(Geometry=filter, Source=filter_2, Target=PlaneXY(0, 0, 0))  # -> Geometry, Transform
bcrop_2 = BoxCrop(Box=orient_2.Geometry)
cloudx = CloudEngineX(Cloud=cloud, Run=Toggle(True), Abort=False, Instruction0=bcrop_2, showinfo=True)
data = Data(cloudx)
decloud_2 = DeconstructCloud(Cloud=data)  # -> Points, Normals, Colors
target_pointcloud = Data(decloud_2.Points)
sourcegeo = Geometry(orient.Geometry)
debrep = DeconstructBrep(Brep=sourcegeo)  # -> Faces, Edges, Vertices
demesh = DeconstructMesh(Mesh=sourcegeo)  # -> Vertices, Faces, Colours, Normals
facen = FaceNormals(Mesh=sourcegeo)  # -> Centers, Normals
dim = Dimensions(Surface=debrep.Faces)  # -> UDimension, VDimension
merge_2 = Merge(Data1=demesh.Vertices, Data2=facen.Centers)  # -> flatten(Result)
addition = Addition(A=dim.VDimension, B=1)
addition_2 = Addition(A=dim.UDimension, B=1)
panel_13 = Panel("-2")  # disabled
sdivide = DivideSurface(Surface=debrep.Faces, UCount=addition_2, VCount=addition)  # -> flatten(Points), Normals, Parameters
panel_14 = Panel("25")
panel_15 = Panel("10")
ext = ExtendCurve(Curve=item_2.Item1, Type=0, Start=panel_13, End=panel_13)  # disabled
cloudx_2 = CloudEngineX(Cloud=cloud, Run=Toggle(True), Abort=False, Instruction0=bcrop, showinfo=True)  # disabled
trimmedcloud = Data(cloud)
mm_2 = Panel("1/25")
mm_3 = Panel("0.0393701")
data_2 = Data(merge_2)
reb = RebuildCurve(Curve=ext, Count=10, Tangents=False)  # disabled
panel_16 = Panel(cloudx_2)
scale_2 = Scale(Geometry=cloudx_2, Center=Point(0, 0, 0), Factor=mm_3)  # -> Geometry, Transform; disabled
color = ColourSwatch(SwatchColor=RGB(130, 130, 130))

# ---- group: Canvas Settings
group_names_corresponding_to_colors_belo = Panel("""_in
_out
_analysis
_goal
_visual""")  # "Group names corresponding to colors below"
groups_with_hidden_wires = Panel("_visual")
color_2 = ColourSwatch(SwatchColor=RGBA(0, 0, 0, 150))
color_3 = ColourSwatch(SwatchColor=RGBA(64, 0, 255, 150))
color_4 = ColourSwatch(SwatchColor=RGBA(120, 6, 6, 150))
color_5 = ColourSwatch(SwatchColor=RGBA(0, 255, 153, 150))
merge_3 = Merge(Data1=color_2, Data2=color_3, Data3=color_4, Data4=color_5)
default_color = ColourSwatch(SwatchColor=RGBA(227, 227, 227, 90))
bool = Boolean(invert(update_wires_and_groups))
changebackground = GhPythonScript(
    change=change_background_color,
    newBackgroundColor=color,
    wireColor=RGB(110, 110, 110),
    selectedWireColor=RGB(47, 255, 0))  # inputs newBackgroundColor: Color, wireColor: Color, selectedWireColor: Color
# ---------- changebackground: Python ----------
"""
    Expanded by Nathan Barnes - AZahner
"""

import Grasshopper as gh
import rhinoscriptsyntax as rs

newShadeColor = rs.CreateColor(0,0,0,20)
newEdgeColor = rs.CreateColor(0,0,0,40)

if(change):
     gh.GUI.Canvas.GH_Skin.canvas_back = newBackgroundColor
     gh.GUI.Canvas.GH_Skin.canvas_shade = newShadeColor
     gh.GUI.Canvas.GH_Skin.canvas_edge = newEdgeColor
     gh.GUI.Canvas.GH_Skin.wire_default = wireColor
     gh.GUI.Canvas.GH_Skin.wire_selected_a = selectedWireColor
     gh.GUI.Canvas.GH_Skin.wire_selected_b = selectedWireColor
# ---------- end changebackground ----------
group_color = GroupColor(
    run=bool,
    groupNames=group_names_corresponding_to_colors_belo,
    groupNamesIgnore=group_names_to_ignore,
    colors=merge_3,
    defaultColor=default_color)  # inputs run: Boolean, groupNames: list of String, groupNamesIgnore: list of String, colors: list of Color, defaultColor: Color
# ---------- group_color: C# usings ----------
using System.Drawing;
using Grasshopper.Kernel.Special;
# ---------- group_color: C# ----------
    // Created by Timo Harboe Nielsen - Rambøll.
    // Expanded by Nathan Barnes - AZahner

    if(!run){
      return;
    }
    GH_Document doc = owner.OnPingDocument();
    foreach (var dobj in doc.Objects)
    {
      GH_Group _group = dobj as GH_Group;
      if( _group == null){
        continue;
      }
      string groupName = _group.NickName.ToString();

      bool changeColor = true;
      //Check if groupName is to be ignored
      for(int i = 0; i < groupNamesIgnore.Count; i++){
        string compareName = groupNamesIgnore[i];
        if(groupName.IndexOf(compareName, StringComparison.OrdinalIgnoreCase) >= 0){
          changeColor = false;
        }
      }

      if(!changeColor){continue;}

      for(int i = 0; i < Math.Min(groupNames.Count, colors.Count); i++){
        string compareName = groupNames[i];
        if(groupName.IndexOf(compareName, StringComparison.OrdinalIgnoreCase) >= 0){
          _group.Colour = colors[i];
          break;
        } else{
          _group.Colour = defaultColor;
        }
      }
    }
# ---------- end group_color ----------
wdt = FaintWires(updateWires=bool, hiddenGroups=groups_with_hidden_wires)  # inputs updateWires: Boolean, hiddenGroups: list of String
# ---------- wdt: C# usings ----------
using System.IO;
using System.Linq;
using System.Data;
using System.Drawing;
using System.Reflection;
using System.Windows.Forms;
using System.Xml;
using System.Xml.Linq;
using System.Runtime.InteropServices;

using Rhino.DocObjects;
using Rhino.Collections;
using GH_IO;
using GH_IO.Serialization;

using Grasshopper.Kernel.Special;
# ---------- wdt: C# ----------
    //Get ID's of objects in desired groups

    GH_Document doc = owner.OnPingDocument();
    List<System.Guid> objectIDs = new List<System.Guid>();
    foreach (var dobj in doc.Objects)
    {

      GH_Group _group = dobj as GH_Group;
      if( _group == null){
        continue;
      }
      for(int i = 0; i < hiddenGroups.Count; i++){
        string groupName = _group.NickName.ToString();
        string compareName = hiddenGroups[i];
        if(groupName.IndexOf(compareName, StringComparison.OrdinalIgnoreCase) >= 0){
          objectIDs.AddRange(_group.ObjectIDs);
          break;
        }
      }
    }

    // Manipulate wires
    foreach(IGH_ActiveObject activeObject in GrasshopperDocument.ActiveObjects()){
      if(activeObject.SubCategory == "Primitive" || activeObject.SubCategory == "Geometry"){
        if(activeObject is IGH_Param){
          IGH_Param param = activeObject as IGH_Param;
          int wire = 0;  //0 default, 1 faint, 2 hidden
          for(int i = 0; i < param.SourceCount; i++){
            IGH_ActiveObject activeObjectSource = param.Sources[i].Attributes.GetTopLevel.DocObject as IGH_ActiveObject;
            if(activeObjectSource.SubCategory == "Primitive" || activeObjectSource.SubCategory == "Geometry"){
              if(objectIDs.Contains(activeObject.InstanceGuid) && !objectIDs.Contains(activeObjectSource.InstanceGuid)){
                wire = 2;
              } else {
                wire = 1;
              }
            } else{
              wire = 0;
              break;
            }
          }
          if(wire == 1){
            fixWires(param, updateWires);
          }
          if(wire == 2){
            hideWires(param, updateWires);
          }

        }
      }
    }
# ---------- wdt: C# additional code ----------
  void fixWires(IGH_Param param, bool showFaint){
    if(showFaint){
      param.WireDisplay = GH_ParamWireDisplay.faint;
    } else{
      GH_ParamWireDisplay ParameterDisplayDefault = (GH_ParamWireDisplay) 0;
      param.WireDisplay = ParameterDisplayDefault;
    }
  }

  void hideWires(IGH_Param param, bool showFaint){
    if(showFaint){
      param.WireDisplay = GH_ParamWireDisplay.hidden;
    } else{
      GH_ParamWireDisplay ParameterDisplayDefault = (GH_ParamWireDisplay) 0;
      param.WireDisplay = ParameterDisplayDefault;
    }
  }
# ---------- end wdt ----------

# ----
data_3 = Data(data_2)
filter_3 = StreamFilter(Gate=box_2, Stream1=sourcegeo)
data_4 = Data(target_pointcloud)

# ----
# Writes point data to file
panel_17 = Panel("""# .PCD v.7 - Point Cloud Data file format
VERSION .7
FIELDS x y z
SIZE 4 4 4
TYPE F F F
COUNT 1 1 1
WIDTH {0}
HEIGHT 1
VIEWPOINT 0 0 0 1 0 0 0
POINTS {0}
DATA ascii""")
lng_2 = ListLength(List=data_4)
pdecon_2 = Deconstruct(Point=data_3)  # -> XComponent, YComponent, ZComponent
lng_3 = ListLength(List=data_3)
pdecon_3 = Deconstruct(Point=data_4)  # -> XComponent, YComponent, ZComponent
format = Format(Format=panel_17, Culture=127, Data0=lng_2)
format_2 = Format(Format="{0} {1} {2}", Culture=127, Data0=pdecon_3.XComponent, Data1=pdecon_3.YComponent, Data2=pdecon_3.ZComponent)
format_3 = Format(Format=panel_17, Culture=127, Data0=lng_3)
format_4 = Format(Format="{0} {1} {2}", Culture=127, Data0=pdecon_2.XComponent, Data1=pdecon_2.YComponent, Data2=pdecon_2.ZComponent)
merge_4 = Merge(Data1=format, Data2=format_2)
merge_5 = Merge(Data1=format_3, Data2=format_4)
join_2 = TextJoin(Text=merge_4)
join_3 = TextJoin(Text=merge_5)

panel_18 = Panel("Trash features")
panel_19 = Panel("1.75")
panel_20 = Panel("2")
panel_21 = Panel("500")
panel_22 = Panel("orb registration")
panel_23 = Panel("2.2")
panel_24 = Panel("1.5")
panel_25 = Panel("10000")
runicp = BooleanToggle(False)
pointtoorient = Data(join_3)
pointtomatch = Data(join_2)
panel_26 = Panel("http://127.0.0.1:5001/icpMatch")
hops = Hops(
    Run=runicp,
    PtToMatch=pointtoorient,
    PtToOrient=pointtomatch,
    IcpThreshold="1",
    VoxelSize="2",
    Num_iterationsVox="10000",
    CacheResultsInMemory=False,
    CacheSolveResults=False,
    RemoteDefinitionLocation="http://127.0.0.1:5001/icpMatchz",
    RemoteSolveVersion=(0, 1, 0),
    ShowInput_Enabled=False,
    ShowInput_Path=False,
    SynchronousSolve=False)  # -> FastTransMatrix, TransMatrix, Result_ransac
source = Data(filter_3)
target = Data(sourcegeo)
icp = Data(hops.TransMatrix)
fast = Data(hops.FastTransMatrix)
panel_27 = Panel(hops.Result_ransac)
# use sticky to preserve transform
python_3 = GhPythonScript(Transform=icp, run=runicp, reset=Button())  # -> out, done; inputs Transform: list, reset: Boolean
# ---------- python_3: Python ----------
__author__ = "nbarnes"
__version__ = "2022.11.05"

import scriptcontext as rs

print("starting")
#print(Transform)

if (reset):
    rs.sticky["transformCount"] = 0
    rs.sticky["".format(rs.sticky["transformCount"])] = ""
    done = False


if Transform is not None and not len(Transform) <1 and run:
    print ("transform not none", len(Transform), Transform, )
    
    try:
        print ("sitcky value", rs.sticky["transformCount"])
        rs.sticky["transformCount"] += 1
        rs.sticky["".format(rs.sticky["transformCount"])] = Transform
        print("dictionary", rs.sticky["transformCount"], rs.sticky["".format(rs.sticky["transformCount"])])
        done = True
    
    except:
        rs.sticky["transformCount"] = 0
        rs.sticky["transformSave".format(rs.sticky["transformCount"])] = ""
        print("added dictionary")
        done = True
    
else:
    print("Sticky Value",  rs.sticky["transformCount"], rs.sticky["".format(rs.sticky["transformCount"])])
    done = False
# ---------- end python_3 ----------
data_5 = Data(python_3.done)
panel_28 = Panel(python_3.out)

# ----
# Transform Fast
panel_29 = Panel("""[
 
]""")
rep_2 = ReplaceText(Text=fast, Find=",", RecursiveReplace=False)
split_4 = TextSplit(Text=rep_2, Separators=panel_29)  # -> flatten(Result)
len_2 = TextLength(Text=split_4)
smaller_3 = SmallerThan(FirstNumber=len_2, SecondNumber=1)  # -> SmallerThan, OrEqualTo
cull_4 = CullPattern(List=split_4, CullPattern=invert(smaller_3.SmallerThan))
num_2 = Number(cull_4)
matrix_2 = ConstructMatrix(Rows="4", Columns="4", Values=num_2)
xy_3 = XYPlane(Origin=Point(0, 0, 0))
transform_2 = Transform(Geometry=xy_3, Transform=matrix_2)
orient_3 = Orient(Geometry=source, Source=transform_2, Target=PlaneXY(0, 0, 0))  # -> Geometry, Transform
preview_2 = CustomPreview(Geometry=orient_3.Geometry, Material=ColourSwatch(SwatchColor=RGB(69, 62, 62)))

# ----
# ICP Transform
panel_30 = Panel("""[
 
]""")
rep_3 = ReplaceText(Text=icp, Find=",", RecursiveReplace=False)
split_5 = TextSplit(Text=rep_3, Separators=panel_30)  # -> flatten(Result)
len_3 = TextLength(Text=split_5)
smaller_4 = SmallerThan(FirstNumber=len_3, SecondNumber=1)  # -> SmallerThan, OrEqualTo
cull_5 = CullPattern(List=split_5, CullPattern=invert(smaller_4.SmallerThan))
num_3 = Number(cull_5)
matrix_3 = ConstructMatrix(Rows="4", Columns="4", Values=num_3)
xy_4 = XYPlane(Origin=Point(0, 0, 0))
transform_3 = Transform(Geometry=xy_4, Transform=matrix_3)
orient_4 = Orient(Geometry=source, Source=transform_3, Target=PlaneXY(0, 0, 0))  # -> Geometry, Transform
preview_3 = CustomPreview(Geometry=orient_4.Geometry, Material=ColourSwatch(SwatchColor=RGB(88, 138, 62)))

minvert = InvertMatrix(Matrix=matrix_2, Tolerance=0)  # -> Matrix, Success
minvert_2 = InvertMatrix(Matrix=matrix_3, Tolerance=0)  # -> Matrix, Success
dematrix = DeconstructMatrix(Matrix=minvert_2.Matrix)  # -> Rows, Columns, Values
matrix_4 = DisplayMatrix(matrix_3)
boxprop_2 = BoxProperties(Box=orient_4.Geometry)  # -> Center, Diagonal, Area, Volume, Degeneracy
hops_2 = Hops(
    MatrixArray=dematrix.Values,
    Scale=0.2,
    CacheResultsInMemory=True,
    CacheSolveResults=True,
    RemoteDefinitionLocation="C:\Users\nbarnes\Documents\GitHub\atom2bits2atoms\TransformHint.gh",
    RemoteSolveVersion=(0, 1, 0),
    ShowInput_Enabled=False,
    ShowInput_Path=False,
    SynchronousSolve=False)
Z = UnitZ(Factor="10")
to_transform_num = Panel(lng_3)
to_match_num = Panel(lng_2)
avr = Average(Input=target_pointcloud)
preview_4 = CustomPreview(Geometry=source, Material=ColourSwatch(SwatchColor=RGB(255, 0, 0)))
move = Move(Geometry=boxprop_2.Center, Motion=Z)  # -> Geometry, Transform
orient_5 = Orient(Geometry=hops_2, Source=PlaneXY(0, 0, 0), Target=move.Geometry)  # -> Geometry, Transform
panel_31 = Panel(icp)
panel_32 = Panel(fast)
